# Grasshopper definition test_hops.gh (Grasshopper 1.0.7)

curves = GetGeometry(AtLeast=1, AtMost=1, DeleteInput=False, Filter=1074004028)
count = GetInteger(AtLeast=1, AtMost=1, Maximum=2147483647, Minimum=-2147483648)
divide = DivideCurve(Curve=curves, Count=count, Kinks=False)  # -> Points, Tangents, Parameters
rev = ReverseList(List=divide.Points)
ln = Line(StartPoint=divide.Points, EndPoint=rev)
divide_2 = DivideCurve(Curve=ln, Count=Slider(10, range=0..10), Kinks=False)  # -> Points, Tangents, Parameters
context_bake = ContextBake(Geometry=ln)
context_bake_2 = ContextBake(Geometry=divide_2.Points)
